# Dynamo custom node CreateEvaluationPoints.dyf (Dynamo 0.8.2.2392)
# category: Illumyno.Illumyno.Helpers
# Creates Points to Evaluate Illumination

surface = Input(surface : Surface)
distance = Input(distance : double)
offset = Surface.Offset(surface, distance)
perimeterCurves = Surface.PerimeterCurves(offset)
byJoinedCurves = PolyCurve.ByJoinedCurves(perimeterCurves)
offset_2 = Input(offset : double)
offset_3 = Curve.Offset(curve=byJoinedCurves, distance=offset_2)
byPatch = Surface.ByPatch(offset_3)
numU = Input()
numV = Input()
code_block = CodeBlock(numU=numU, numV=numV) { 0..1..#numU; 0..1..#numV; }
pointAtParameter = Surface.PointAtParameter(surface=byPatch, u=code_block.out0, v=code_block.out1, lacing=CrossProduct)
flatten = Flatten(pointAtParameter)
Points = Output(flatten)
