# Dynamo custom node DiffWindowsFromWall.dyf (Dynamo 0.8.2.2392)
# category: Illumyno.Illumyno.Helpers
# Returns the wall with removed window surfaces

surface = Input(surface : Surface)
surface_2 = Input(surface : Surface)
code_block = CodeBlock { 1000; }
thicken = Surface.Thicken(surface=surface_2, thickness=code_block)
subtractFrom = Surface.SubtractFrom(surface=surface, trimmingEntity=thicken)
Geometry = Output(subtractFrom)  # "Geometry[]"
