# Dynamo graph Illumyno.dyn (Dynamo 0.8.2.2392)

file_path = Filename("C:\Users\no98kad\AppData\Roaming\Dynamo\0.8\definitions\sky.mat")

# group: Sky
now = DateTime.Now()
code_block = CodeBlock { "-a 51 -o 0 -m 0"; }
skyAtDateTime = Illumyno.Generators.SkyAtDateTime(now, code_block)
string = StringInput("""
skyfunc glow skyglow
0
0
4 .85 1.04 1.2 0

skyglow source sky
0
0
4 0 0 1 180

skyfunc glow groundglow
0
0
4 .8 1.1 .8 0

groundglow source ground
0
0
4 0 0 -1 180
""")
concat = String.Concat(skyAtDateTime, string)

writeText = File.WriteText(file_path, concat)
file_path_2 = Filename("C:\Users\no98kad\AppData\Roaming\Dynamo\0.8\definitions\materials.rad")

# group: materials
code_block_2 = CodeBlock { "void"; "plastic"; "cieling-mat"; 0.9; 0.1; }
material = Illumyno.RadObject.Material(code_block_2.out0, code_block_2.out1, code_block_2.out2, code_block_2.out3, code_block_2.out3, code_block_2.out3, code_block_2.out4, code_block_2.out4)
code_block_3 = CodeBlock { "void"; "plastic"; "wall-mat"; 0.7; 0.1; }
material_2 = Illumyno.RadObject.Material(code_block_3.out0, code_block_3.out1, code_block_3.out2, code_block_3.out3, code_block_3.out3, code_block_3.out3, code_block_3.out4, code_block_3.out4)
code_block_4 = CodeBlock { "void"; "glass"; "glazing-mat"; 0.68; }
code_block_5 = CodeBlock { null; }
material_3 = Illumyno.RadObject.Material(code_block_4.out0, code_block_4.out1, code_block_4.out2, code_block_4.out3, code_block_4.out3, code_block_4.out3, code_block_5, code_block_5)
code_block_6 = CodeBlock { "void"; "plastic"; "floor-mat"; 0.5; 0.1; }
material_4 = Illumyno.RadObject.Material(code_block_6.out0, code_block_6.out1, code_block_6.out2, code_block_6.out3, code_block_6.out3, code_block_6.out3, code_block_6.out4, code_block_6.out4)
create = List.Create(material, material_2, material_3, material_4)
objectsToString = Illumyno.Helpers.ObjectsToString(create)

code_block_7 = CodeBlock { ","; "."; }
replace = String.Replace(str=objectsToString, searchFor=code_block_7.out0, replaceWith=code_block_7.out1)
writeText_2 = File.WriteText(file_path_2, replace)
file_path_3 = Filename("C:\Users\no98kad\AppData\Roaming\Dynamo\0.8\definitions\objects.rad")

# group: Geometry
string_from_object = FromObject(material)
code_block_8 = CodeBlock { "cieling"; }
width = DoubleSlider(5.8, range=5..10 step 0.1)
length = DoubleSlider(6, range=5..10 step 0.1)
height = DoubleSlider(3.9, range=3..5 step 0.1)
byLengths = Cuboid.ByLengths(arg1=width, arg2=length, arg3=height)
faces = Topology.Faces(byLengths)
surfaceGeometry = Face.SurfaceGeometry(faces)
ceiling = CodeBlock(a=surfaceGeometry) { a[0]; }
vertices = Topology.Vertices(ceiling)
pointGeometry = Vertex.PointGeometry(vertices)
polygon = Illumyno.RadObject.Polygon(string_from_object, code_block_8, pointGeometry)
string_from_object_2 = FromObject(material_2)
code_block_9 = CodeBlock { "wall"; }
walls = CodeBlock(a=surfaceGeometry) { a[2]; a[3]; a[4]; a[5]; }
glazing_percentage_south = DoubleSlider(0.25, range=0.05..0.95 step 0.05)
byGlazingPercentage = Illumyno.Helpers.ByGlazingPercentage(walls.out0, glazing_percentage_south)
diffWindowsFromWall = Custom[DiffWindowsFromWall](surface=walls.out0, surface_2=byGlazingPercentage)  # Returns the wall with removed window surfaces
code_block_10 = CodeBlock { 0.1; }
tesselateSurface = Illumyno.Helpers.TesselateSurface(diffWindowsFromWall, code_block_10)
glazing_percentage_west = DoubleSlider(0.6, range=0.05..0.95 step 0.05)
byGlazingPercentage_2 = Illumyno.Helpers.ByGlazingPercentage(walls.out1, glazing_percentage_west)
diffWindowsFromWall_2 = Custom[DiffWindowsFromWall](surface=walls.out1, surface_2=byGlazingPercentage_2)
code_block_11 = CodeBlock { 0.1; }
tesselateSurface_2 = Illumyno.Helpers.TesselateSurface(diffWindowsFromWall_2, code_block_11)
glazing_percentage_north = DoubleSlider(0.35, range=0.05..0.95 step 0.05)
byGlazingPercentage_3 = Illumyno.Helpers.ByGlazingPercentage(walls.out2, glazing_percentage_north)
diffWindowsFromWall_3 = Custom[DiffWindowsFromWall](surface=walls.out2, surface_2=byGlazingPercentage_3)
code_block_12 = CodeBlock { 0.1; }
tesselateSurface_3 = Illumyno.Helpers.TesselateSurface(diffWindowsFromWall_3, code_block_12)
glazing_percentage_east = DoubleSlider(0.6, range=0.05..0.95 step 0.05)
byGlazingPercentage_4 = Illumyno.Helpers.ByGlazingPercentage(walls.out3, glazing_percentage_east)
diffWindowsFromWall_4 = Custom[DiffWindowsFromWall](surface=walls.out3, surface_2=byGlazingPercentage_4)
code_block_13 = CodeBlock { 0.1; }
tesselateSurface_4 = Illumyno.Helpers.TesselateSurface(diffWindowsFromWall_4, code_block_13)
walls_2 = List.Create(tesselateSurface, tesselateSurface_2, tesselateSurface_3, tesselateSurface_4)
polygon_2 = Illumyno.RadObject.Polygon(string_from_object_2, code_block_9, walls_2)
string_from_object_3 = FromObject(material_3)
code_block_14 = CodeBlock { "window"; }
windows = List.Create(byGlazingPercentage, byGlazingPercentage_2, byGlazingPercentage_3, byGlazingPercentage_4)
vertices_2 = Topology.Vertices(windows)
pointGeometry_2 = Vertex.PointGeometry(vertices_2)
polygon_3 = Illumyno.RadObject.Polygon(string_from_object_3, code_block_14, pointGeometry_2)
string_from_object_4 = FromObject(material_4)
code_block_15 = CodeBlock { "floor"; }
floor = CodeBlock(a=surfaceGeometry) { a[1]; }
vertices_3 = Topology.Vertices(floor)
pointGeometry_3 = Vertex.PointGeometry(vertices_3)
polygon_4 = Illumyno.RadObject.Polygon(string_from_object_4, code_block_15, pointGeometry_3)
create_2 = List.Create(polygon, polygon_2, polygon_3, polygon_4)
flatten = Flatten(create_2)
objectsToString_2 = Illumyno.Helpers.ObjectsToString(flatten)

code_block_16 = CodeBlock { ","; "."; }
replace_2 = String.Replace(str=objectsToString_2, searchFor=code_block_16.out0, replaceWith=code_block_16.out1)
writeText_3 = File.WriteText(file_path_3, replace_2)
file_path_4 = Filename("C:\Users\no98kad\AppData\Roaming\Dynamo\0.8\definitions\scene2.oct")
createSceneFromFiles = Illumyno.Simulation.CreateSceneFromFiles(file_path, file_path_2, file_path_3)
writeText_4 = File.WriteText(file_path_4, createSceneFromFiles)

# group: Evaluation Points
integer_slider = IntegerSlider(3, range=1..10 step 1)
integer_slider_2 = IntegerSlider(3, range=1..10 step 1)
distance_from_surface = CodeBlock { -1; }
offset_from_surface_edges = CodeBlock { -1; }
createEvaluationPoints = Custom[CreateEvaluationPoints](numU=integer_slider, numV=integer_slider_2, surface=floor, distance=distance_from_surface, offset=offset_from_surface_edges)  # Creates Points to Evaluate Illumination
ZAxis = Vector.ZAxis()
evaluationPointsList = Illumyno.Helpers.EvaluationPointsList(createEvaluationPoints, ZAxis)

code_block_17 = CodeBlock { ","; "."; }
replace_3 = String.Replace(str=evaluationPointsList, searchFor=code_block_17.out0, replaceWith=code_block_17.out1)
calculateLux = Illumyno.Simulation.CalculateLux(replace_3, file_path_4)
watch = Watch(calculateLux)
